# Grasshopper definition test.gh (Grasshopper 1.0.7)
# plug-ins: Tutorial Plugin

timer = Timer(TimerInterval=20, Target=xbox_controller)
xbox_controller = XBoxController()  # -> A, B, X, Y, ButtonShoulderLeft, ButtonShoulderRight, Up, Down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
panel = Panel([xbox_controller.A, xbox_controller.B, xbox_controller.X, xbox_controller.Y, xbox_controller.ButtonShoulderLeft, xbox_controller.ButtonShoulderRight, xbox_controller.Up, xbox_controller.Down, xbox_controller.Left, xbox_controller.Right, xbox_controller.Start, xbox_controller.Back, xbox_controller.TriggerLeft, xbox_controller.TriggerRight, xbox_controller.ThumbpadLeft, xbox_controller.ThumbpadRight, xbox_controller.LeftThumbstickX, xbox_controller.LeftThumbstickY, xbox_controller.RightThumbstickX, xbox_controller.RightThumbstickY, xbox_controller.TiggerLeftPosition, xbox_controller.TiggerRightPosition])

number_slider = Slider(-20, range=-100..0)
number_slider_2 = Slider(35, range=0..100)
construct_domain = ConstructDomain(DomainStart=number_slider, DomainEnd=number_slider_2)
curve = Curve(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)
curve_2 = Curve(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)
remap_numbers = RemapNumbers(Value=xbox_controller.TiggerRightPosition, Source=Domain(0, 100), Target=construct_domain)  # -> Mapped, Clipped
remap_numbers_2 = RemapNumbers(Value=xbox_controller.TiggerLeftPosition, Source=Domain(0, 100), Target=construct_domain)  # -> Mapped, Clipped
circle = Circle({Plane=PlaneXY(-25.15496417, 48.11259001, 0), Radius=7.903002398})
point = Point(Point(-46.49307065, -9.088452757, 0))
circle_2 = Circle({Plane=PlaneXY(25.81940129, 48.11259001, 0), Radius=7.903002398})
merge = Merge(Data1=xbox_controller.ButtonShoulderLeft, Data2=xbox_controller.ButtonShoulderRight)
merge_2 = Merge(Data1=xbox_controller.TriggerLeft, Data2=xbox_controller.TriggerRight)
surface = Surface([curve_2, curve])
circle_3 = Circle({Plane=PlaneXY(48.18103134, -7.408216491, 0), Radius=26.88601416})
circle_4 = Circle({Plane=PlaneXY(-91.370185, 48.604313, 0), Radius=26.88601416})
merge_3 = Merge(Data1=xbox_controller.Start, Data2=xbox_controller.Back)
polygon = Polygon(Plane=point, Radius=Slider(20, range=0..100), Segments=4, FilletRadius=0)  # -> Polygon, Length
point_2 = Point(Point(-93.17737395, 140.0099807, 0))
point_3 = Point(Point(92.86027817, 48.99861487, 0))
construct_domain_2 = ConstructDomain(DomainStart=number_slider, DomainEnd=remap_numbers_2.Mapped)
construct_domain_3 = ConstructDomain(DomainStart=remap_numbers.Mapped, DomainEnd=number_slider_2)
construct_domain_4 = ConstructDomain(DomainStart=remap_numbers_2.Mapped, DomainEnd=number_slider_2)
construct_domain_5 = ConstructDomain(DomainStart=number_slider, DomainEnd=remap_numbers.Mapped)
surface_2 = Surface([circle_2, circle])
cluster = Cluster_2(arc=circle_4, value=xbox_controller.LeftThumbstickX, value_2=xbox_controller.LeftThumbstickY)
integer = Integer(merge)
integer_2 = Integer(merge_2)
cluster_2 = Cluster_2(arc=circle_3, value=xbox_controller.RightThumbstickX, value_2=xbox_controller.RightThumbstickY)
mirror = Mirror(Geometry=point_2, Plane=PlaneYZ(0, 0, 0))  # -> Geometry, Transform
polygon_2 = Polygon(Plane=point_3, Radius=Slider(24, range=0..100), Segments=4, FilletRadius=0)  # -> Polygon, Length
merge_4 = Merge(Data1=xbox_controller.Right, Data2=xbox_controller.Up, Data3=xbox_controller.Left, Data4=xbox_controller.Down)
colour_hsl = ColourHSL(Alpha=1, Hue=0, Saturation=1, Luminance=integer)
colour_hsl_2 = ColourHSL(Alpha=1, Hue=0, Saturation=1, Luminance=integer_2)  # -> simplify(graft(Colour))
discontinuity = Discontinuity(Curve=polygon.Polygon, Level=1)  # -> Points, Parameters
merge_5 = Merge(Data1=construct_domain_4, Data2=construct_domain_3)  # -> simplify(graft(Result))
merge_6 = Merge(Data1=construct_domain_2, Data2=construct_domain_5)  # -> simplify(graft(Result))
integer_3 = Integer(merge_3)
discontinuity_2 = Discontinuity(Curve=polygon_2.Polygon, Level=1)  # -> Points, Parameters
circle_5 = Circle(Plane=cluster_2, Radius=15)
integer_4 = Integer(merge_4)
merge_7 = Merge(Data1=xbox_controller.ThumbpadLeft, Data2=xbox_controller.ThumbpadRight)
custom_preview = CustomPreview(Geometry=surface, Material=colour_hsl)
colour_hsl_3 = ColourHSL(Alpha=1, Hue=0, Saturation=1, Luminance=integer_3)
circle_6 = Circle(Plane=cluster, Radius=15)
rectangle = Rectangle(Plane=discontinuity.Points, XSize=Domain(-10, 10), YSize=Domain(-10, 10), Radius=0)  # -> Rectangle, Length
merge_8 = Merge(Data1=merge_6, Data2=merge_5)
colour_hsl_4 = ColourHSL(Alpha=1, Hue=0, Saturation=1, Luminance=integer_4)
rectangle_2 = Rectangle(Plane=simplify(graft([point_2, mirror.Geometry])), XSize=Domain(-15, 15), YSize=merge_8, Radius=0)  # -> Rectangle, Length
shift_list = ShiftList(List=discontinuity_2.Points, Shift=Slider(3, range=0..10), Wrap=True)
surface_3 = Surface(circle_5)
merge_9 = Merge(Data1=xbox_controller.A, Data2=xbox_controller.B, Data3=xbox_controller.Y, Data4=xbox_controller.X)
surface_4 = Surface(rectangle.Rectangle)
custom_preview_2 = CustomPreview(Geometry=surface_2, Material=colour_hsl_3)
integer_5 = Integer(merge_7)
surface_5 = Surface(circle_6)
circle_7 = Circle(Plane=shift_list, Radius=Slider(12, range=0..100))
colour_hsl_5 = ColourHSL(Alpha=1, Hue=0, Saturation=1, Luminance=integer_5)  # -> simplify(graft(Colour))
list_item = ListItem(List=rectangle_2.Rectangle, Index=0, Wrap=True)  # -> Item, Item1
integer_6 = Integer(merge_9)
merge_10 = Merge(Data1=circle_4, Data2=circle_3)  # -> simplify(graft(Result))
merge_11 = Merge(Data1=surface_5, Data2=surface_3)  # -> simplify(graft(Result))
custom_preview_3 = CustomPreview(Geometry=surface_4, Material=colour_hsl_4)
surface_6 = Surface(circle_7)
colour_hsl_6 = ColourHSL(Alpha=1, Hue=0, Saturation=1, Luminance=integer_6)
surface_7 = Surface(list_item.Item)
rectangle_3 = Rectangle(list_item.Item1)
clean_tree = CleanTree(RemoveNulls=True, RemoveInvalid=True, RemoveEmpty=False, Tree=surface_7)
merge_12 = Merge(Data1=merge_11, Data2=merge_10)
curve_3 = Curve(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)
custom_preview_4 = CustomPreview(Geometry=surface_6, Material=colour_hsl_6)
custom_preview_5 = CustomPreview(Geometry=curve_3, Material=ColourSwatch(SwatchColor=RGB(0, 0, 0)))
merge_13 = Merge(Data1=clean_tree, Data2=rectangle_3)
custom_preview_6 = CustomPreview(Geometry=merge_12, Material=colour_hsl_5)
custom_preview_7 = CustomPreview(Geometry=merge_13, Material=colour_hsl_2)

# ==== cluster Cluster_2
arc = ClusterInput()
value = ClusterInput()
value_2 = ClusterInput()
deconstruct_arc = DeconstructArc(Arc=arc)  # -> BasePlane, Radius, Angle
cluster = Cluster(value_2=value, value=value_2)
move = Move(Geometry=deconstruct_arc.BasePlane, Motion=cluster)  # -> Geometry, Transform
geometry = ClusterOutput(move.Geometry)

# ==== cluster Cluster
value = ClusterInput()
value_2 = ClusterInput()
remap_numbers = RemapNumbers(Value=value, Source=Domain(0, 100), Target=Domain(-25, 25))  # -> Mapped, Clipped
remap_numbers_2 = RemapNumbers(Value=value_2, Source=Domain(0, 100), Target=Domain(-25, 25))  # -> Mapped, Clipped
unit_y = UnitY(Factor=remap_numbers.Mapped)
unit_x = UnitX(Factor=remap_numbers_2.Mapped)
addition = Addition(A=unit_x, B=unit_y)
result = ClusterOutput(addition)
